# Grasshopper definition project1.gh (Grasshopper 1.0.8)
# plug-ins: Firefly.Core

number_slider = Slider(10, range=0..10)
point = Point(<point referenced from the Rhino model>)
boolean_toggle = BooleanToggle(True)
hexagonal = Hexagonal(Plane=PlaneXY(0, 0, 0), Size=1, ExtentX=Slider(9, range=0..10), ExtentY=Slider(11, range=0..100))  # -> Cells, Points
number_slider_2 = Slider(4, range=0..10)
trigger = Trigger(Interval=10, TimerInterval=10, Target=serial_read_generic)
serial_read_generic = SerialReadGeneric(StartReadingValues=boolean_toggle, PortNumber=number_slider_2)  # -> SerialOutput, StatusMessage
point_2 = Point(hexagonal.Points)
distance = Distance(PointA=point_2, PointB=point)
multiplication = Multiplication(A=distance, B=Slider(0.06, range=0..0.1))
open_close_port = OpenClosePort(OpenClosePort=boolean_toggle, PortNumber=number_slider_2, BaudRate=Slider(9600, range=0..10000))
circle = Circle(Plane=point_2, Radius=multiplication)
construct_domain = ConstructDomain(DomainStart=0, DomainEnd=Slider(10, range=0..10))
construct_domain_2 = ConstructDomain(DomainStart=0, DomainEnd=1)
panel = Panel(distance)
boundary_surfaces = BoundarySurfaces(Edges=circle)
unit_z = UnitZ(Factor=distance)
panel_2 = Panel(open_close_port)
extrude = Extrude(Base=boundary_surfaces, Direction=unit_z)
text_split = TextSplit(Text=serial_read_generic.SerialOutput, Separators=",")
custom_preview = CustomPreview(Geometry=extrude, Material=ColourSwatch(SwatchColor=RGB(51, 0, 255)))
list_item = ListItem(List=text_split, Index=Slider(0, range=0..100), Wrap=True)
remap_numbers = RemapNumbers(Value=list_item, Source=construct_domain_2, Target=construct_domain)  # -> Mapped, Clipped
unit_z_2 = UnitZ(Factor=remap_numbers.Mapped)
move = Move(Geometry=point, Motion=unit_z_2)  # -> Geometry, Transform
list_item_2 = ListItem(List=text_split, Index=Slider(1, range=0..100), Wrap=True)
panel_3 = Panel(text_split)
