# Grasshopper definition project2.gh (Grasshopper 1.0.8)

trigger = Trigger(Interval=50, TimerInterval=50, Target=data_recorder)  # disabled
data_recorder = DataRecorder(Slider(0, range=0..100), DataLimit=-10, RecordData=True)
panel = Panel(data_recorder)
list_length = ListLength(List=panel)
panel_2 = Panel(list_length)
construct_point = ConstructPoint(XCoordinate=0, YCoordinate=0, ZCoordinate=0)
division = Division(A=panel_2, B=Slider(5, range=0..100))
radius = Slider(3, range=0..10)
colour_picker = ColourPicker(PickedColour=RGB(0, 0, 0))
sine = Sine(Value=division)
absolute = Absolute(Value=sine)
A = Slider(0, range=0..100)
multiplication = Multiplication(A=absolute, B=Slider(6, range=0..10))
multiplication_2 = Multiplication(A=multiplication, B=Slider(2, range=0..10))
unit_z = UnitZ(Factor=multiplication_2)
move = Move(Geometry=construct_point, Motion=unit_z)  # -> Geometry, Transform
sphere = Sphere(Base=move.Geometry, Radius=1)
circle = Circle(Plane=PlaneXY(0, 0, 0), Radius=radius)
angle = Slider(23, range=0..1000)
custom_preview = CustomPreview(Geometry=sphere, Material=colour_picker)
unit_z_2 = UnitZ(Factor=multiplication)
subtraction = Subtraction(A=A, B=angle)
move_2 = Move(Geometry=circle, Motion=unit_z_2)  # -> Geometry, Transform
count = Slider(23, range=0..100)
rotate = Rotate(Angle=1.570796327, Plane=PlaneXY(0, 0, 0))  # -> Geometry, Transform
rotate_2 = Rotate(Geometry=move_2.Geometry, Angle=subtraction, Plane=PlaneXY(0, 0, 0))  # -> Geometry, Transform
rotate_3 = Rotate(Geometry=move_2.Geometry, Angle=angle, Plane=PlaneXY(0, 0, 0))  # -> Geometry, Transform
divide_curve = DivideCurve(Curve=circle, Count=count, Kinks=False)  # -> Points, Tangents, Parameters
divide_curve_2 = DivideCurve(Curve=rotate_2.Geometry, Count=count, Kinks=False)  # -> Points, Tangents, Parameters
divide_curve_3 = DivideCurve(Curve=rotate_3.Geometry, Count=count, Kinks=False)  # -> Points, Tangents, Parameters
line = Line(StartPoint=divide_curve.Points, EndPoint=divide_curve_2.Points)
line_2 = Line(StartPoint=divide_curve.Points, EndPoint=divide_curve_3.Points)
radius_2 = Slider(0.07, range=0..0.1)
caps = Slider(2, range=0..10)
merge = Merge(Data1=circle, Data2=rotate_3.Geometry, Data3=line, Data4=line_2)
pipe = Pipe(Curve=merge, Radius=radius_2, Caps=caps)
colour_picker_2 = ColourPicker(PickedColour=RGB(251, 0, 255))
panel_3 = Panel(colour_picker_2)
custom_preview_2 = CustomPreview(Geometry=pipe, Material=panel_3)
